# Grasshopper definition TestConnection.gh (Grasshopper 1.0.7)
# Copyright: 2021
# plug-ins: GrasshopperRadianceLinuxConnector

connect_ssh = ConnectSSH(User="mss", Ip="127.0.0.1", Password="_prompt", _port=22, Connect=Toggle(True))
testconnection = TestConnection()
panel = Panel(connect_ssh)
panel_2 = Panel(testconnection)
